# Grasshopper definition Control_UDP.gh (Grasshopper 0.9.76)
# plug-ins: Firefly.X

# ----
# ZSQD Motion Control
panel = Panel("q")
pressed = IsKeyPressed(KeyToTest=panel)
pressed_2 = IsKeyPressed(KeyToTest="z")
pressed_3 = IsKeyPressed(KeyToTest="d")
pressed_4 = IsKeyPressed(KeyToTest="s")
panel_2 = Panel([pressed_2, pressed_4, pressed, pressed_3])
# Sending Frequency
reset = Button()
gain = Slider(10, range=0..10)
x_plane = Slider(0, range=-10..10)
c_script = CSharpScript(x=pressed_2, y=pressed_4, reset=reset)  # -> out, A; inputs x: Boolean, y: Boolean, reset: Boolean
# ---------- c_script: C# ----------
    if(!reset)
    {
      int n = 0;
      if(x){n++;}
      if(y){n--;}
      corr += n;
    }
    else
    {
      corr = 0;
    }
    A = corr;
# ---------- c_script: C# additional code ----------
  int corr = 0;
# ---------- end c_script ----------
c_script_2 = CSharpScript(x=pressed_3, y=pressed, reset=reset)  # -> out, A; inputs x: Boolean, y: Boolean, reset: Boolean; same code as c_script
multiplication = Multiplication(A=[x_plane, c_script_2.A, c_script.A], B=gain)
join = TextJoin(Text=multiplication, Join=" ")
panel_3 = Panel(join)

# ----
# Curve Motion Control
number_slider = Slider(496, range=0..1000)
start = BooleanToggle(False)
crv = Curve(<curve referenced from the Rhino model>)
c_script_3 = CSharpScript(start=start)  # -> out, A; inputs start: Boolean
# ---------- c_script_3: C# ----------
    if(start)
    {
      count++;
    }
    else{count = 0;}
    A = count;
# ---------- c_script_3: C# additional code ----------
  double count = -1;
# ---------- end c_script_3 ----------
divide = DivideCurve(Curve=crv, Count=number_slider, Kinks=False)  # -> Points, Tangents, Parameters
panel_4 = Panel(c_script_3.A)
pdecon = Deconstruct(Point=divide.Points)  # -> XComponent, YComponent, ZComponent
item = ListItem(List=pdecon.XComponent, Index=c_script_3.A, Wrap=True)
item_2 = ListItem(List=pdecon.YComponent, Index=c_script_3.A, Wrap=True)
item_3 = ListItem(List=pdecon.ZComponent, Index=c_script_3.A, Wrap=True)
join_2 = TextJoin(Text=[item, item_2, item_3], Join=" ")
panel_5 = Panel(join_2)

timer = Timer(TimerInterval=50, Target=[udp_sender, c_script_3, pressed_2, pressed_4, pressed, pressed_3])

# ----
# UDP Sending
panel_6 = Panel("4000")
udp_sender = UDPSender(Data=join, IPAddressOfUDPServer="172.29.1.131", UDPPort=panel_6)
